# Dynamo graph Add Shared Parameters.dyn (Dynamo 2.6.1.8786)
# packages: Orchid 250.0.2.7501

file_path = Filename(".\Data.xlsx")
file_from_path = FileObject(path=file_path)
code_block = CodeBlock(ExcelFile=file_from_path)
# ---------- code_block.designscript (13 lines) ----------
//Import Excel Data
ImportExcelFile = DSOffice.Data.ImportExcel(ExcelFile, "Shared Parameters", false, false);
RemoveHeaders	= DSCore.List.RestOfItems(ImportExcelFile);
ExcelData 		= DSCore.List.Transpose(RemoveHeaders);

//Shared Parameters
CurrentDocument = RevitProject.Document.Current;
ParameterName   = ExcelData[0];
GroupName 		= ExcelData[1];
parameterType 	= ExcelData[2];
parameterGroup 	= ExcelData[3];
isInstance 		= ExcelData[4] == "Yes";
isReporting 	= ExcelData[5] == "Yes";
# ----------------------------------------
add = Orchid.RevitFamily.SharedParameter.Add(familyDocument=code_block.CurrentDocument, parameterName=code_block.ParameterName, groupName=code_block.GroupName, type=code_block.parameterType, group=code_block.parameterGroup, instance=code_block.isInstance, reporting=code_block.isReporting)
