# Dynamo graph Dimension Intersecting Walls.dyn (Dynamo 2.6.1.8786)
# packages: Genius Loci 2020.7.10

current = Document.Current()
activeView = Document.ActiveView(document=current)
select_model_element = DSModelElementSelection()  # 1 picked in the model
categories = Categories("OST_Walls")
all_elements_of_category = ElementsOfCategory(Category=categories)
element_types = ElementTypes("DimensionType")
all_elements_of_type = ElementsOfType(element_type=element_types)
code_block = CodeBlock(Line1=select_model_element, Walls1=all_elements_of_category, Dimensions1=all_elements_of_type)
# ---------- code_block.designscript (14 lines) ----------
//Detail Line
DetailLine = Elements.Element.Geometry(Line1);

//Convert Walls To Geometry
AllWalls   = Elements.Element.GetLocation(Walls1);

//Walls That Intersect Line
WallMask 		  = Autodesk.Geometry.DoesIntersect(AllWalls<1L>, DetailLine<1L>);
FilterWalls 	  = DSCore.List.FilterByBoolMask(Walls1, WallMask);
IntersectingWalls = DesignScript.Dictionary.ValueAtKey(FilterWalls, "in");

//Dimension Type
DimensionNames 	  = Elements.Element.Name(Dimensions1);
DimensionType1 	  = Dimensions1[0];
# ----------------------------------------
# note: GeniusLoci
compound_surfaces_references = Custom[Compound Surfaces References](element=code_block.IntersectingWalls)  # package Genius Loci; Retrieves Top, Bottom and Side Faces, Materials, and references of a roof, floor, ceiling or wall if applicable. Also works with linked element.
dimension_byreferences = Custom[Dimension ByReferences](view=activeView, line=code_block.DetailLine, references=compound_surfaces_references.References, dimensionType=code_block.DimensionType1)  # package Genius Loci; Creates a new linear dimension from at least two geometric references of an object.
