# Dynamo graph Levels_Create.dyn "Levels - Create" (Dynamo 2.6.1.8786)

file_path = Filename("Work\Dynamo\Data.xlsx")
file_from_path = FileObject(path=file_path)
code_block = CodeBlock(ExcelFile=file_from_path)
# ---------- code_block.designscript (14 lines) ----------
//Import Excel Data
ImportExcelFile = DSOffice.Data.ImportExcel(ExcelFile, "Levels", false, false);
RemoveHeaders	= DSCore.List.RestOfItems(ImportExcelFile);
ExcelData 		= DSCore.List.Transpose(RemoveHeaders);

//Level Names & Elevations
LevelNames 		= ExcelData[0];
LevelElevations = ExcelData[1];

//Create Levels & Plans
CreateLevels 	      = Level.ByElevationAndName(LevelElevations, LevelNames);
CreateFloorPlans      = FloorPlanView.ByLevel(CreateLevels);
CreateCeilingPlans 	  = CeilingPlanView.ByLevel(CreateLevels);
CreateStructuralPlans = StructuralPlanView.ByLevel(CreateLevels);
# ----------------------------------------
