# Dynamo graph Levels_Modify Elevations.dyn "Levels_Elevations" (Dynamo 2.6.1.8786)

file_path = Filename(".\Data.xlsx")
file_from_path = FileObject(path=file_path)
categories = Categories("OST_Levels")
all_elements_of_category = ElementsOfCategory(Category=categories)
code_block = CodeBlock(ExcelFile=file_from_path, Levels=all_elements_of_category)
# ---------- code_block.designscript (14 lines) ----------
//Import Excel Data
ImportExcelFile = DSOffice.Data.ImportExcel(ExcelFile, "Levels", false, false);
RemoveHeaders	= DSCore.List.RestOfItems(ImportExcelFile);
ExcelData 		= DSCore.List.Transpose(RemoveHeaders);

//Level Elevations To Modify
LevelElevationsToModify = DSCore.List.Slice(Levels, 1, 11, 1);

//New Level Elevations
LevelElevations    = ExcelData[1];
NewLevelElevations = DSCore.List.Slice(LevelElevations, 0, 10, 1);

//Modify Level Elevations
ModifyLevelElevations = Elements.Element.SetParameterByName(LevelElevationsToModify, "Elevation", NewLevelElevations);
# ----------------------------------------
