# Dynamo graph Renumber_Elements.dyn "Renumber Elements" (Dynamo 2.6.1.8786)

select_model_element = DSModelElementSelection()  # 1 picked in the model
select_model_elements = DSModelElementsSelection()  # 16 picked in the model
code_block = CodeBlock(spline=select_model_element, Elements1=select_model_elements)
# ---------- code_block.designscript (30 lines) ----------
//Convert Spline Into Geometry
Spline = Revit.Element.Geometry(spline);

//Convert Element Into Geometry
elements = Revit.Element.GetLocation(Elements1);

//Pull Spline Onto XY Plane
PlaneXY     = Plane.XY();
SplinePlane = Curve.PullOntoPlane(Spline, PlaneXY);

//Closest Points
XPoints 	  = Autodesk.Point.X(elements);
YPoints 	  = Autodesk.Point.Y(elements);
ElementPoints = Autodesk.Point.ByCoordinates(XPoints, YPoints, 0);
SplinePoints  = Curve.ParameterAtPoint(SplinePlane<1L>, ClosestPoints<1L>);
ClosestPoints = Geometry.ClosestPointTo(SplinePlane<1L>, ElementPoints<1L>);

//Closest Elements
ReorderElementPoints = DSCore.List.SortByKey(Elements1, SplinePoints);
ReorderedElements	 = Dictionary.ValueAtKey(ReorderElementPoints, "sorted list");

//Renumber Sequence
NumberOfElements = DSCore.List.Count(ReorderedElements);
StartingNumber 	 = 1;
Prefix1 		 = "W.";
RenumberRange 	 = StartingNumber..StartingNumber+(NumberOfElements-1)..1;
RenumberSequence = Prefix1 + RenumberRange;

//Renumber Elements
RenumberElements = Revit.Element.SetParameterByName(ReorderedElements, "Mark", RenumberSequence);
# ----------------------------------------
