# Dynamo graph Renumber_Rooms.dyn "Renumber Rooms" (Dynamo 2.6.1.8786)

select_model_element = DSModelElementSelection()  # 1 picked in the model
categories = Categories("OST_Rooms")
all_elements_of_category = ElementsOfCategory(Category=categories)
finishBoundary = Room.FinishBoundary(room=all_elements_of_category)
code_block = CodeBlock(Spline1=select_model_element, RoomBoundaries1=finishBoundary, Rooms1=all_elements_of_category)
# ---------- code_block.designscript (35 lines) ----------
//Convert Spline Into Geometry
Spline = Revit.Element.Geometry(Spline1);

//Room Boundaries
RoomBoundaries = PolyCurve.ByJoinedCurves(RoomBoundaries1, 1);

//Pull Spline & Room Boundaries Onto XY Plane
PlaneXY        = Plane.XY();
SplinePlane    = Curve.PullOntoPlane(Spline, PlaneXY);
RoomsPlane     = Curve.PullOntoPlane(RoomBoundaries, PlaneXY);
RoomsPlaneList = DSCore.List.Flatten(RoomsPlane, -1);

//Intersecting Points
MaskIntersectingPoints 	 = Geometry.Intersect(SplinePlane<1L>, RoomsPlaneList<1L>);
EmptyList 				 = DSCore.List.IsEmpty(MaskIntersectingPoints<1L>);
FilterIntersectingPoints = DSCore.List.FilterByBoolMask(MaskIntersectingPoints, EmptyList);
IntersectingPoints 	 	 = Dictionary.ValueAtKey(FilterIntersectingPoints, "out");
IntersectingPointsList 	 = DSCore.List.GetItemAtIndex(IntersectingPoints<1L>, 0);
SplinePoints 	 		 = Curve.ParameterAtPoint(SplinePlane<1L>, IntersectingPointsList<1L>);

//Intersecting Rooms
FilterIntersectingRooms = DSCore.List.FilterByBoolMask(Rooms1, EmptyList);
IntersectingRooms 		= Dictionary.ValueAtKey(FilterIntersectingRooms, "out");
ReorderRoomPoints		= DSCore.List.SortByKey(IntersectingRooms, SplinePoints);
ReorderedRooms 			= Dictionary.ValueAtKey(ReorderRoomPoints, "sorted list");

//Renumber Sequence
NumberOfRooms 	 = DSCore.List.Count(ReorderedRooms);
StartingNumber 	 = 201;
Prefix1 		 = "R.";
RenumberRange 	 = StartingNumber..StartingNumber+(NumberOfRooms-1)..1;
RenumberSequence = Prefix1 + RenumberRange;

//Renumber Rooms
RenumberRooms = Revit.Element.SetParameterByName(ReorderedRooms, "Number", RenumberSequence);
# ----------------------------------------
