# Dynamo graph Sheets_Create.dyn (Dynamo 2.6.1.8786)

file_path = Filename(".\Data.xlsx")  # graph input
file_from_path = FileObject(path=file_path)
family_types = FamilyTypes("A1 metric:A1 metric")  # graph input
views = Views("Architectural Elevation")  # graph input
code_block = CodeBlock(ExcelFile=file_from_path, Titleblock=family_types, View1=views)
# ---------- code_block.designscript (11 lines) ----------
//Import Excel Data
ImportExcelFile = DSOffice.Data.ImportExcel(ExcelFile, "Sheets", false, false);
RemoveHeaders	= DSCore.List.RestOfItems(ImportExcelFile);
ExcelData 		= DSCore.List.Transpose(RemoveHeaders);

//Sheet Numbers & Names
SheetNumbers = ExcelData[0];
SheetNames   = ExcelData[1];

//Create Sheets
Elements.Views.Sheet.ByNameNumberTitleBlockAndView(SheetNames, SheetNumbers, Titleblock, View1);
# ----------------------------------------
