# Dynamo graph Sheets_Rename.dyn (Dynamo 2.6.1.8786)

file_path = Filename(".\Data.xlsx")  # graph input
file_from_path = FileObject(path=file_path)
categories = Categories("OST_Sheets")
all_elements_of_category = ElementsOfCategory(Category=categories)
code_block = CodeBlock(ExcelFile=file_from_path, Sheets=all_elements_of_category)
# ---------- code_block.designscript (14 lines) ----------
//Import Excel Data
ImportExcelFile = DSOffice.Data.ImportExcel(ExcelFile, "Sheets", false, false);
RemoveHeaders	= DSCore.List.RestOfItems(ImportExcelFile);
ExcelData 		= DSCore.List.Transpose(RemoveHeaders);

//Sheet Names
SheetNames      = ExcelData[1];
NewSheetNames   = DSCore.List.Slice(SheetNames, 0, 10, 1);

//Sheets To Rename
SheetsToRename  = DSCore.List.Slice(Sheets, 0, 10, 1);

//Rename Sheets
Elements.Element.SetParameterByName(SheetsToRename, "Sheet Name", NewSheetNames);
# ----------------------------------------
