# Dynamo graph Sheets_Renumber.dyn (Dynamo 2.6.1.8786)

file_path = Filename(".\Data.xlsx")  # graph input
file_from_path = FileObject(path=file_path)
categories = Categories("OST_Sheets")
all_elements_of_category = ElementsOfCategory(Category=categories)
code_block = CodeBlock(ExcelFile=file_from_path, Sheets=all_elements_of_category)
# ---------- code_block.designscript (14 lines) ----------
//Import Excel Data
ImportExcelFile  = DSOffice.Data.ImportExcel(ExcelFile, "Sheets", false, false);
RemoveHeaders	 = DSCore.List.RestOfItems(ImportExcelFile);
ExcelData 		 = DSCore.List.Transpose(RemoveHeaders);

//Sheet Numbers
SheetNumbers     = ExcelData[0];
NewSheetNumbers  = DSCore.List.Slice(SheetNumbers, 0, 10, 1);

//Sheets To Renumber
SheetsToRenumber = DSCore.List.Slice(Sheets, 0, 10, 1);

//Renumber Sheets
Elements.Element.SetParameterByName(SheetsToRenumber, "Sheet Number", NewSheetNumbers);
# ----------------------------------------
