# Dynamo graph Views_Duplicate.dyn (Dynamo 2.6.1.8786)
# packages: Clockwork for Dynamo 2.x 2.3.0, archi-lab.net 2021.25.14

file_path = Filename(".\Data.xlsx")
file_from_path = FileObject(path=file_path)
# note: archilab
view_type = ViewTypesUi("FloorPlan")
code_block = CodeBlock(ExcelFile=file_from_path, ViewType1=view_type)
# ---------- code_block.designscript (11 lines) ----------
//Import Excel Data
ImportExcelFile = DSOffice.Data.ImportExcel(ExcelFile, "Views", false, false);
RemoveHeaders	= DSCore.List.RestOfItems(ImportExcelFile);
ExcelData 		= DSCore.List.Transpose(RemoveHeaders);

//View To Duplicate
ViewsList 		= Views.GetByType(ViewType1);
ViewToDuplicate = ViewsList[0];

//Duplicated View Names
DuplicatedViewNames = ExcelData[0];
# ----------------------------------------
# note: Clockwork
duplicateWithDetailing = Custom[View.DuplicateWithDetailing](view=code_block.ViewToDuplicate, name=code_block.DuplicatedViewNames)  # package Clockwork for Dynamo 2.x; Duplicates a given view with detailing
