# Dynamo graph Views_Place On Sheets.dyn (Dynamo 2.6.1.8786)
# packages: archi-lab.net 2021.25.11, SteamNodes 1.2.4

categories = Categories("OST_Sheets")
all_elements_of_category = ElementsOfCategory(Category=categories)
# note: archilab
view_type = ViewTypesUi("FloorPlan")
code_block = CodeBlock(Sheets1=all_elements_of_category, Views1=view_type)
# ---------- code_block.designscript (10 lines) ----------
//Sheet With View
SheetWithView = Sheets1[0];
SheetViewport = Sheets.Viewports(SheetWithView);

//Sheets To Have Views
SheetsToHaveViews = DSCore.List.Slice(Sheets1, 1, 10, 1);

//Views To Be Placed On Sheets
ViewsList         = Views.GetByType(Views1);
ViewsToBePlaced   = DSCore.List.Slice(ViewsList, 1, 10, 1);
# ----------------------------------------
# note: SteamNodes
viewPortBoxCenter = Custom[View.ViewPortBoxCenter](Viewports=code_block.SheetViewport)  # package SteamNodes; Get ViewPort Box center point
code_block_2 = CodeBlock(Points1=viewPortBoxCenter)
# ---------- code_block_2.designscript (2 lines) ----------
//Duplicate Viewports
Viewports1 = DSCore.List.Cycle(Points1, 9);
# ----------------------------------------
placeViewsOnExistingSheets = Custom[Tool.PlaceViewsOnExistingSheets](Sheet=code_block.SheetsToHaveViews, View=code_block.ViewsToBePlaced, Point=code_block_2)  # package SteamNodes; Place the views on the sheets at the points you provide.
