# Dynamo graph Views_Rename.dyn (Dynamo 2.6.1.8786)
# packages: archi-lab.net 2021.25.11

file_path = Filename("Work\Dynamo\Data.xlsx")
file_from_path = FileObject(path=file_path)
# note: archilab
view_type = ViewTypesUi("FloorPlan")
code_block = CodeBlock(ExcelFile=file_from_path, ViewType1=view_type)
# ---------- code_block.designscript (14 lines) ----------
//Import Excel Data
ImportExcelFile = DSOffice.Data.ImportExcel(ExcelFile, "Views", false, false);
RemoveHeaders	= DSCore.List.RestOfItems(ImportExcelFile);
ExcelData 		= DSCore.List.Transpose(RemoveHeaders);

//New View Names
NewViewNames    = ExcelData[0];

//Views To Rename
ViewsList       = Views.GetByType(ViewType1);
ViewsToRename   = DSCore.List.Slice(ViewsList, 0, 10, 1);

//Rename Views
Elements.Element.SetParameterByName(ViewsToRename, "View Name", NewViewNames);
# ----------------------------------------
